% Requirement links of ecgClassify.m (R2024a)

% line 1 implements ecgAppReq.slreqx#17
function [cout, score, h_rate, b_rate, hr_sig, br_sig] = ecgClassify(ecgSignal, sampleRate)

% line 5 implements ecgAppReq.slreqx#19
    jetdata = coder.load("cmap.mat");

% line 10 implements ecgAppReq.slreqx#19
    ECGNet = coder.loadDeepLearningNetwork("ECGNet.mat");

% lines 19-20 implements ecgAppReq.slreqx#20
img = ind2rgb(im2uint8(rescale(abs(cfs))), jetdata.cmap);
imgCl = im2uint8(imresize(img, [227,227]));

% lines 24-28 implements ecgAppReq.slreqx#21
if gpuDeviceCount > 0
    executionMode = "gpu";
elseif ~isempty(gcp("nocreate"))
    executionMode = "parallel";
end

% line 40 implements ecgAppReq.slreqx#22
[cout_ML, ~] = verifyML(ecgSignal);