% Requirement links of patient.m (R2023a)

% line 1 implements ecgAppReq.slreqx#1: OK
function p = patient(first, last, age, id, signal, freq)

% lines 16-19 implements ecgAppReq.slreqx#2
    assert(nameCond, ...
        'patient:InvalidName', 'Invalid patient''s name found')
    assert(isalpha(first) && isalpha(last), ...
        'patient:InvalidName', 'Invalid patient''s name found')

% lines 20-21 implements ecgAppReq.slreqx#3
    assert(isnumeric(age) && age >= 0 && age <= 150, ...
        'patient:InvalidAge', 'Patient''s age must be between 0 and 150')

% lines 22-23 implements ecgAppReq.slreqx#4
    assert(isnumeric(id) && mod(id,1) == 0 && id > 0, ...
        'patient:InvalidId', 'Patient''s ID must be an integer greater than 0')

% lines 24-25 implements ecgAppReq.slreqx#6
    assert(isnumeric(signal) && length(signal) > 1, 'patient:InvalidSignal', ...
        'Signal array must be numeric')

% lines 26-28 implements ecgAppReq.slreqx#5
    assert(isscalar(freq) && isnumeric(freq) && freq > 0 && mod(freq, 1) == 0, ...
        'patient:InvalidFreq', ...
        'Signal frequency must be an integer')