% Requirement links of ecgClassifyTest.m (R2023a)

% line 1 verifies ecgAppReq.slreqx#17
classdef ecgClassifyTest < matlab.unittest.TestCase

% line 17 verifies ecgAppReq.slreqx#19
        function validClassifyTest(testCase, patientId)

% lines 28-29 verifies ecgAppReq.slreqx#22
            verifyEqual(testCase, classOut, 'ARR')
            verifyGreaterThanOrEqual(testCase, score, 0.999)