% Requirement links of patientTest.m (R2023a)

% line 1 verifies ecgAppReq.slreqx#1: OK
classdef patientTest < matlab.unittest.TestCase

% line 26 verifies ecgAppReq.slreqx#2
        function validNameString(testCase, nameIndex)

% line 60 verifies ecgAppReq.slreqx#3
        function validAgeTest(testCase, validAge)

% line 65 verifies ecgAppReq.slreqx#3
        function invalidAgeTest(testCase, invalidAge)

% line 70 verifies ecgAppReq.slreqx#4
        function validIdTest(testCase, validId)

% line 75 verifies ecgAppReq.slreqx#4
        function invalidIdTest(testCase, invalidId)

% line 80 verifies ecgAppReq.slreqx#5
        function validFrequency(testCase, validFreq)

% line 85 verifies ecgAppReq.slreqx#5
        function invalidFrequency(testCase, invalidFreq)

% line 90 verifies ecgAppReq.slreqx#6
        function validSignal(testCase, validFreq)

% line 95 verifies ecgAppReq.slreqx#6
        function invalidSignal(testCase, invalidSig)